% Simulink data dictionary CSP.sldd

CSP_BTE2BMS_3_1 = mpt.Signal(StorageClass="ExportedGlobal", DataType="uint8")
CSP_BTE2BMS_3_7 = mpt.Signal(StorageClass="ExportedGlobal", DataType="uint8")
CSP_BTE2BMS_3_6 = mpt.Signal(StorageClass="ExportedGlobal", DataType="uint8")
CSP_BTE2BMS_3_5 = mpt.Signal(StorageClass="ExportedGlobal", DataType="uint8")
CSP_BTE2BMS_3_4 = mpt.Signal(StorageClass="ExportedGlobal", DataType="uint8")
CSP_BTE2BMS_3_3 = mpt.Signal(StorageClass="ExportedGlobal", DataType="uint8")
CSP_BTE2BMS_3_2 = mpt.Signal(StorageClass="ExportedGlobal", DataType="uint8")
CSP_BTE2BMS_3_0 = mpt.Signal(StorageClass="ExportedGlobal", DataType="uint8")
CSP_CSP_stTestRelayCtrlType = mpt.Signal(StorageClass="ExportedGlobal", DataType="uint8")
CSP_CSP_stTestShuntDownCmd = mpt.Signal(StorageClass="ExportedGlobal", DataType="uint8")
CSP_CSP_stSelfDefRlySts = mpt.Signal(StorageClass="ExportedGlobal", DataType="uint8")
CSP_CSP_stChrgNgtvRlySts = mpt.Signal(StorageClass="ExportedGlobal", DataType="uint8")
CSP_CSP_stTestNegRlySts = mpt.Signal(StorageClass="ExportedGlobal", DataType="uint8")
CSP_CSP_stTestHtgchrgRlySts = mpt.Signal(StorageClass="ExportedGlobal", DataType="uint8")
CSP_CSP_stTestSlwchrgRlySts = mpt.Signal(StorageClass="ExportedGlobal", DataType="uint8")
CSP_CSP_stTestQckchrgRlySts = mpt.Signal(StorageClass="ExportedGlobal", DataType="uint8")
CSP_CSP_stTestPosRlySts = mpt.Signal(StorageClass="ExportedGlobal", DataType="uint8")
CSP_CSP_stTestPrechrgRlySts = mpt.Signal(StorageClass="ExportedGlobal", DataType="uint8")
CSP_CSP_stTestSlowChrgCmd = mpt.Signal(StorageClass="ExportedGlobal", DataType="uint8")
CSP_CSP_stTestFastChrgCmd = mpt.Signal(StorageClass="ExportedGlobal", DataType="uint8")
CSP_CSP_stTestDischrgCmd = mpt.Signal(StorageClass="ExportedGlobal", DataType="uint8")
CSP_BTE2BMS_2_2 = mpt.Signal(StorageClass="ExportedGlobal", DataType="uint8")
CSP_BTE2BMS_2_1 = mpt.Signal(StorageClass="ExportedGlobal", DataType="uint8")
CSP_BTE2BMS_2_0 = mpt.Signal(StorageClass="ExportedGlobal", DataType="uint8")
CSP_BTE2BMS_1_7 = mpt.Signal(StorageClass="ExportedGlobal", DataType="uint8")
CSP_BTE2BMS_1_6 = mpt.Signal(StorageClass="ExportedGlobal", DataType="uint8")
CSP_BTE2BMS_1_5 = mpt.Signal(StorageClass="ExportedGlobal", DataType="uint8")
CSP_BTE2BMS_1_4 = mpt.Signal(StorageClass="ExportedGlobal", DataType="uint8")
CSP_BTE2BMS_1_3 = mpt.Signal(StorageClass="ExportedGlobal", DataType="uint8")
CSP_BTE2BMS_1_2 = mpt.Signal(StorageClass="ExportedGlobal", DataType="uint8")
CSP_BTE2BMS_1_1 = mpt.Signal(StorageClass="ExportedGlobal", DataType="uint8")
CSP_BTE2BMS_1_0 = mpt.Signal(StorageClass="ExportedGlobal", DataType="uint8")
CSP_Diag_PhyReq_BMS_Data_L = mpt.Signal(StorageClass="ExportedGlobal", DataType="uint32")
CSP_Diag_PhyReq_BMS_Data_H = mpt.Signal(StorageClass="ExportedGlobal", DataType="uint32")
CSP_Diag_FuncReq_Data_L = mpt.Signal(StorageClass="ExportedGlobal", DataType="uint32")
CSP_Diag_FuncReq_Data_H = mpt.Signal(StorageClass="ExportedGlobal", DataType="uint32")
CSP_TBOX_DateTimeYr = mpt.Signal(StorageClass="ExportedGlobal", DataType="uint16")
CSP_TBOX_DateTimeMth = mpt.Signal(StorageClass="ExportedGlobal", DataType="uint8")
CSP_TBOX_DateTimeDay = mpt.Signal(StorageClass="ExportedGlobal", DataType="uint8")
CSP_TBOX_DateTimeHr = mpt.Signal(StorageClass="ExportedGlobal", DataType="uint8")
CSP_TBOX_DateTimeMin = mpt.Signal(StorageClass="ExportedGlobal", DataType="uint8")
CSP_TBOX_DateTimeSec = mpt.Signal(StorageClass="ExportedGlobal", DataType="uint8")
CSP_iCurr = mpt.Signal(StorageClass="ExportedGlobal", DataType="uint32")
CSP_stCurrSensErrFlag = mpt.Signal(StorageClass="ExportedGlobal", DataType="uint8")
CSP_stCurrSensErrInfo = mpt.Signal(StorageClass="ExportedGlobal", DataType="uint8")
ERR_stSlwChrgErr = mpt.Signal(StorageClass="ExportedGlobal", DataType="uint8")
ERR_stDisChrgErr = mpt.Signal(StorageClass="ExportedGlobal", DataType="uint8")
CSP_AsmAerosolData = mpt.Signal(StorageClass="ExportedGlobal", DataType="uint16")
CSP_AsmErrStatus = mpt.Signal(StorageClass="ExportedGlobal", DataType="uint8")
CSP_AsmHwErr = mpt.Signal(StorageClass="ExportedGlobal", DataType="uint8")
BCU800E5 = Simulink.Parameter(1, StorageClass="ImportedDefine", HeaderFile="app_cfg.h", DataType="uint8")
CSP_ChrgSocTarSp = mpt.Signal(StorageClass="ExportedGlobal", DataType="uint8")
INVALID_CAN_ID = Simulink.Parameter(Simulink.data.Expression(ExpressionString="hex2dec('FFFFFFFF')"), StorageClass="Define", HeaderFile="can_message.h", DataType="uint32")
CAN_DATATYPE_SUPPORT_DATA_MAX_LEN = Simulink.Parameter(8, StorageClass="Define", HeaderFile="can_message.h", DataType="uint8")
BTE2BMS_1_Msg = mpt.Signal(StorageClass="ImportedExtern", DataType="Bus: CAN_MESSAGE_BUS")
BTE2BMS_2_Msg = mpt.Signal(StorageClass="ImportedExtern", DataType="Bus: CAN_MESSAGE_BUS")
BTE2BMS_3_Msg = mpt.Signal(StorageClass="ImportedExtern", DataType="Bus: CAN_MESSAGE_BUS")
CANHALL_msg = mpt.Signal(StorageClass="ImportedExtern", DataType="Bus: CAN_MESSAGE_BUS")
VCU3 = mpt.Signal(StorageClass="ImportedExtern", DataType="Bus: CAN_MESSAGE_BUS")
BPSParaState_Cycle = mpt.Signal(StorageClass="ImportedExtern", DataType="Bus: CAN_MESSAGE_BUS")
CSP_uOBCChrgOutVltg = Simulink.Signal(StorageClass="ExportedGlobal", DataType="single")
CSP_iOBCChrgOutCurr = Simulink.Signal(StorageClass="ExportedGlobal", DataType="single")
CSP_stPDUDisChrgAnodeRly = Simulink.Signal(StorageClass="ExportedGlobal", DataType="uint8")
CSP_stVCUHVinterlockFault = Simulink.Signal(StorageClass="ExportedGlobal", DataType="boolean")
CSP_stVCUIgnitionRequest = Simulink.Signal(StorageClass="ExportedGlobal", DataType="uint8")
CSP_stVCUPreChrg = Simulink.Signal(StorageClass="ExportedGlobal", DataType="uint8")
CSP_pwrVCUFastchrgAllowed = Simulink.Signal(StorageClass="ExportedGlobal", DataType="single")
CSP_pwrVCUSlowchrgAllowed = Simulink.Signal(StorageClass="ExportedGlobal", DataType="single")
CSP_stVCUFastchrgPermittion = Simulink.Signal(StorageClass="ExportedGlobal", DataType="uint8")
CSP_stVCUSlowchrgPermittion = Simulink.Signal(StorageClass="ExportedGlobal", DataType="uint8")
CSP_stVCUChrgRly = Simulink.Signal(StorageClass="ExportedGlobal", DataType="uint8")
CSP_stDisChrgAnodeRlyWld = Simulink.Signal(StorageClass="ExportedGlobal", DataType="uint8")
CSP_stTestAct = Simulink.Signal(StorageClass="ExportedGlobal", DataType="uint8")
CSP_stTestDischrgCmd = Simulink.Signal(StorageClass="ExportedGlobal", DataType="uint8")
CSP_stTestFastChrgCmd = Simulink.Signal(StorageClass="ExportedGlobal", DataType="uint8")
CSP_stTestHtgchrgRlySts = Simulink.Signal(StorageClass="ExportedGlobal", DataType="uint8")
CSP_stTestNegRlySts = Simulink.Signal(StorageClass="ExportedGlobal", DataType="uint8")
CSP_stTestPosRlySts = Simulink.Signal(StorageClass="ExportedGlobal", DataType="uint8")
CSP_stTestPrechrgRlySts = Simulink.Signal(StorageClass="ExportedGlobal", DataType="uint8")
CSP_stTestQckchrgRlySts = Simulink.Signal(StorageClass="ExportedGlobal", DataType="uint8")
CSP_stTestRelayCtrlType = Simulink.Signal(StorageClass="ExportedGlobal", DataType="uint8")
CSP_stTestShuntDownCmd = Simulink.Signal(StorageClass="ExportedGlobal", DataType="uint8")
CSP_stTestSlowChrgCmd = Simulink.Signal(StorageClass="ExportedGlobal", DataType="uint8")
CSP_stTestSlwchrgRlySts = Simulink.Signal(StorageClass="ExportedGlobal", DataType="uint8")
CSP_stOpenOverCurr = Simulink.Signal(StorageClass="ExportedGlobal", DataType="uint8")
CSP_stOBCState = Simulink.Signal(StorageClass="ExportedGlobal", DataType="uint8")
CSP_numYEAR1 = Simulink.Signal(StorageClass="ExportedGlobal", DataType="uint8")
CSP_numYEAR2 = Simulink.Signal(StorageClass="ExportedGlobal", DataType="uint8")
CSP_numMOUTH = Simulink.Signal(StorageClass="ExportedGlobal", DataType="uint8")
CSP_numDAY = Simulink.Signal(StorageClass="ExportedGlobal", DataType="uint8")
CSP_numHOUR = Simulink.Signal(StorageClass="ExportedGlobal", DataType="uint8")
CSP_numMINUTE = Simulink.Signal(StorageClass="ExportedGlobal", DataType="uint8")
CSP_numSECOND = Simulink.Signal(StorageClass="ExportedGlobal", DataType="uint8")
CSP_stOBCCANErr = mpt.Signal(StorageClass="ExportedGlobal", DataType="uint8")
CSP_kmhVehSpd = mpt.Signal(StorageClass="ExportedGlobal", DataType="single")
CSP_stSelfDefRlySts = Simulink.Signal(StorageClass="ExportedGlobal", DataType="uint8")
CSP_stChrgNgtvRlySts = Simulink.Signal(StorageClass="ExportedGlobal", DataType="uint8")
CSP_stVCUChargeCtrl = mpt.Signal(StorageClass="ExportedGlobal", DataType="uint8")
CSP_stChargeMode = mpt.Signal(StorageClass="ExportedGlobal", DataType="uint8")
CSP_stOBCCoolingMode = mpt.Signal(StorageClass="ExportedGlobal", DataType="uint8")
CSP_tOBCTemp = mpt.Signal(StorageClass="ExportedGlobal", DataType="single")
CSP_stOBCHardWareErr = mpt.Signal(StorageClass="ExportedGlobal", DataType="uint8")
CSP_uOBCInputVoltErr = mpt.Signal(StorageClass="ExportedGlobal", DataType="uint8")
CSP_stOBCOverTempErr = mpt.Signal(StorageClass="ExportedGlobal", DataType="uint8")
CSP_stOBCReady = mpt.Signal(StorageClass="ExportedGlobal", DataType="uint8")
CSP_stOBCStart = mpt.Signal(StorageClass="ExportedGlobal", DataType="uint8")
CSP_stVCUChargeEn = mpt.Signal(StorageClass="ExportedGlobal", DataType="uint8")  % 充电使能
CSP_iOBCChrgOutVolt = mpt.Signal(StorageClass="ExportedGlobal", DataType="single")
CSP_stOBCError = mpt.Signal(StorageClass="ExportedGlobal", DataType="uint8")
CSP_stVCUPwrOnCmd = mpt.Signal(StorageClass="ExportedGlobal", DataType="uint8")
VCU_VehHVReady = mpt.Signal(StorageClass="ExportedGlobal", DataType="uint8")
CSP_VCU_VehChgReq = mpt.Signal(StorageClass="ExportedGlobal", DataType="uint8")
CSP_VCU_VehHVReady = mpt.Signal(StorageClass="ExportedGlobal", DataType="uint8")
CSP_VCU_ChgAllwdCrrntMax = mpt.Signal(StorageClass="ExportedGlobal", DataType="single")
CSP_stOutLetHTLvl = mpt.Signal(StorageClass="ExportedGlobal", DataType="uint8")
CSP_OBC_percentCP = mpt.Signal(StorageClass="ExportedGlobal", DataType="single")
CSP_OBC_ChgFaultReq = mpt.Signal(StorageClass="ExportedGlobal", DataType="uint8")
CSP_OBC_StsCP = mpt.Signal(StorageClass="ExportedGlobal", DataType="uint8")
OBC_StsElock = mpt.Signal(StorageClass="ExportedGlobal", DataType="uint8")
OBC_StsChgCC = mpt.Signal(StorageClass="ExportedGlobal", DataType="uint8")
OBC_StsMode = mpt.Signal(StorageClass="ExportedGlobal", DataType="uint8")
CSP_OBC_StsChgCC = mpt.Signal(StorageClass="ExportedGlobal", DataType="uint8")
CSP_OBC_StsElock = mpt.Signal(StorageClass="ExportedGlobal", DataType="uint8")
CSP_OBC_StsMode = mpt.Signal(StorageClass="ExportedGlobal", DataType="uint8")
CSP_OBC_ActCurAC = mpt.Signal(StorageClass="ExportedGlobal", DataType="single")
CSP_OBC_ActCurDC = mpt.Signal(StorageClass="ExportedGlobal", DataType="single")
CSP_OBC_ActVoltAC = mpt.Signal(StorageClass="ExportedGlobal", DataType="single")
CSP_OBC_ActVoltDC = mpt.Signal(StorageClass="ExportedGlobal", DataType="single")
CSP_OBC_MaxCurAC = mpt.Signal(StorageClass="ExportedGlobal", DataType="single")
CSP_OBC_MaxCurDC = mpt.Signal(StorageClass="ExportedGlobal", DataType="single")
CSP_tCCOutlet_L = mpt.Signal(StorageClass="ExportedGlobal", DataType="single")
CSP_tCCOutlet_N = mpt.Signal(StorageClass="ExportedGlobal", DataType="single")
CSP_numCCOutletHT_L = mpt.Signal(StorageClass="ExportedGlobal", DataType="uint8")
CSP_numCCOutletHT_N = mpt.Signal(StorageClass="ExportedGlobal", DataType="uint8")
CSP_VCU_StsModeReq = mpt.Signal(StorageClass="ExportedGlobal", DataType="uint8")
CSP_VCU_StsCrash = mpt.Signal(StorageClass="ExportedGlobal", DataType="uint8")
CSP_ACU_CrashOutputSts = mpt.Signal(StorageClass="ExportedGlobal", DataType="uint8")
CSP_VehicleSpeed = mpt.Signal(StorageClass="ExportedGlobal", DataType="single")
CSP_VehicleSpeedValid = mpt.Signal(StorageClass="ExportedGlobal", DataType="uint8")
CSP_uDCChrgVolt = mpt.Signal(StorageClass="ExportedGlobal", DataType="single")
CSP_Day = mpt.Signal(StorageClass="ExportedGlobal", DataType="uint8")
CSP_Hour = mpt.Signal(StorageClass="ExportedGlobal", DataType="uint8")
CSP_Min = mpt.Signal(StorageClass="ExportedGlobal", DataType="uint8")
CSP_Sec = mpt.Signal(StorageClass="ExportedGlobal", DataType="uint8")
CSP_Month = mpt.Signal(StorageClass="ExportedGlobal", DataType="uint8")
CSP_Odo = mpt.Signal(StorageClass="ExportedGlobal", DataType="single")
CSP_IPU_InputCurr = mpt.Signal(StorageClass="ExportedGlobal", DataType="single")
CSP_IPU_InputVolt = mpt.Signal(StorageClass="ExportedGlobal", DataType="single")
CSP_IPU_StsActiveDischg = mpt.Signal(StorageClass="ExportedGlobal", DataType="uint8")
CSP_Year = mpt.Signal(StorageClass="ExportedGlobal", DataType="uint16")
CSP_BpsWakeupAbnFlg = mpt.Signal(StorageClass="ExportedGlobal", DataType="uint8")
CSP_BpsOutMeasureableFlg = mpt.Signal(StorageClass="ExportedGlobal", DataType="uint8")
CSP_BpsInternalErrorFlag = mpt.Signal(StorageClass="ExportedGlobal", DataType="uint8")
CSP_BpsOverSlope = mpt.Signal(StorageClass="ExportedGlobal", DataType="uint8")
CSP_VehicleSpeedOrig = mpt.Signal(StorageClass="ExportedGlobal", DataType="uint16")
CSP_VCU_HV_PowerCmd = mpt.Signal(StorageClass="ExportedGlobal", DataType="uint8")
CSP_CM_ChgSts = mpt.Signal(StorageClass="ExportedGlobal", DataType="uint8")
CSP_CM_CC_ConnectSts = mpt.Signal(StorageClass="ExportedGlobal", DataType="uint8")
CSP_CM_WorkingMode = mpt.Signal(StorageClass="ExportedGlobal", DataType="uint8")
CSP_CM_CP_DutyCycleValue = mpt.Signal(StorageClass="ExportedGlobal", DataType="uint8")
CSP_CM_HV_OutputUnderVolt = mpt.Signal(StorageClass="ExportedGlobal", DataType="uint8")
CSP_CM_HV_OutputOverVolt = mpt.Signal(StorageClass="ExportedGlobal", DataType="uint8")
CSP_CM_HV_OutputSC = mpt.Signal(StorageClass="ExportedGlobal", DataType="uint8")
CSP_CM_InputUnderVolt = mpt.Signal(StorageClass="ExportedGlobal", DataType="uint8")
CSP_CM_InputOverVolt = mpt.Signal(StorageClass="ExportedGlobal", DataType="uint8")
CSP_CM_12V_UnderVolt = mpt.Signal(StorageClass="ExportedGlobal", DataType="uint8")
CSP_CM_12V_OverVolt = mpt.Signal(StorageClass="ExportedGlobal", DataType="uint8")
CSP_CM_HighCurrOutputFault = mpt.Signal(StorageClass="ExportedGlobal", DataType="uint8")
CSP_CM_CAN_Fault = mpt.Signal(StorageClass="ExportedGlobal", DataType="uint8")
CSP_CM_NoBatt = mpt.Signal(StorageClass="ExportedGlobal", DataType="uint8")
CSP_CM_BattReverse = mpt.Signal(StorageClass="ExportedGlobal", DataType="uint8")
CSP_CM_InputVolt_VD = mpt.Signal(StorageClass="ExportedGlobal", DataType="uint16")
CSP_CM_CP_DutyCycleFault = mpt.Signal(StorageClass="ExportedGlobal", DataType="uint8")
CSP_CM_ChgInterfaceOverTemp = mpt.Signal(StorageClass="ExportedGlobal", DataType="uint8")
CM_ChargerOverTemp = mpt.Signal(StorageClass="ExportedGlobal", DataType="uint8")
CSP_CM_ChargerOverTemp = mpt.Signal(StorageClass="ExportedGlobal", DataType="uint8")
CSP_DCDC_LvSideCurr = mpt.Signal(StorageClass="ExportedGlobal", DataType="single")
CSP_DCDC_LvSideVolt = mpt.Signal(StorageClass="ExportedGlobal", DataType="single")
CSP_DCDC_HvVolt = mpt.Signal(StorageClass="ExportedGlobal", DataType="single")
CSP_DCDC_HvCurr = mpt.Signal(StorageClass="ExportedGlobal", DataType="single")
CSP_OBC_OutputPowerLimt = mpt.Signal(StorageClass="ExportedGlobal", DataType="single")
CSP_OBC_FaultLevelSts = mpt.Signal(StorageClass="ExportedGlobal", DataType="uint8")
CSP_OBC_InputCurr = mpt.Signal(StorageClass="ExportedGlobal", DataType="single")
CSP_OBC_InputVolt = mpt.Signal(StorageClass="ExportedGlobal", DataType="single")
CSP_OBC_KL30_UnderVolt = mpt.Signal(StorageClass="ExportedGlobal", DataType="uint8")
CSP_OBC_CC_ConnectSts = mpt.Signal(StorageClass="ExportedGlobal", DataType="uint8")
CSP_OBC_CP_DutyCycleFault = mpt.Signal(StorageClass="ExportedGlobal", DataType="uint8")
CSP_OBC_CP_DutyCycleValue = mpt.Signal(StorageClass="ExportedGlobal", DataType="uint8")
CSP_OBC_ChgSts = mpt.Signal(StorageClass="ExportedGlobal", DataType="uint8")
CSP_OBC_ElectronicLockSts = mpt.Signal(StorageClass="ExportedGlobal", DataType="uint8")
CSP_OBC_WorkingMode = mpt.Signal(StorageClass="ExportedGlobal", DataType="uint8")
CSP_OBC_MaxOutputCurrent = mpt.Signal(StorageClass="ExportedGlobal", DataType="single")
CSP_OBC_MaxOutputVoltage = mpt.Signal(StorageClass="ExportedGlobal", DataType="single")
CSP_OBC_FaultCode = mpt.Signal(StorageClass="ExportedGlobal", DataType="uint8")
OBC_ChargeSourceMode = mpt.Signal(StorageClass="ExportedGlobal", DataType="uint8")
CSP_HCU_AccessoriesCosumePower = mpt.Signal(StorageClass="ExportedGlobal", DataType="single")
CSP_HCU_BMS_stModeReq = mpt.Signal(StorageClass="ExportedGlobal", DataType="uint8")
CSP_HCU_BattHVHAllow = mpt.Signal(StorageClass="ExportedGlobal", DataType="uint8")
CSP_HCU_BattHeatAllow = mpt.Signal(StorageClass="ExportedGlobal", DataType="uint8")
CSP_HCU_EngineSts = mpt.Signal(StorageClass="ExportedGlobal", DataType="uint8")

CSP_HCU_SleepAllow = mpt.Signal(StorageClass="ExportedGlobal", DataType="uint8")
CSP_HCU_VehicleAllowToCharge = mpt.Signal(StorageClass="ExportedGlobal", DataType="uint8")
CSP_TBOX_BattHeatReq = mpt.Signal(StorageClass="ExportedGlobal", DataType="uint8")
CSP_HCU_HVReady = mpt.Signal(StorageClass="ExportedGlobal", DataType="uint8")
CSP_HCU_PTReady = mpt.Signal(StorageClass="ExportedGlobal", DataType="uint8")
CSP_HCU_PowerModeFed = mpt.Signal(StorageClass="ExportedGlobal", DataType="uint8")
CSP_stDriveCycleActv = mpt.Signal(StorageClass="ExportedGlobal", DataType="uint8")
CSP_stWarmUpCycleActv = mpt.Signal(StorageClass="ExportedGlobal", DataType="uint8")
CSP_LoadValueCalculated = mpt.Signal(StorageClass="ExportedGlobal", DataType="single")
CSP_LoadValueCalculatedValid = mpt.Signal(StorageClass="ExportedGlobal", DataType="uint8")
CSP_AbsoluteThrottlePosValid = mpt.Signal(StorageClass="ExportedGlobal", DataType="uint8")
CSP_AbsoluteThrottlePos = mpt.Signal(StorageClass="ExportedGlobal", DataType="single")
CSP_EngineCoolantTemperture = mpt.Signal(StorageClass="ExportedGlobal", DataType="single")
CSP_EngineCoolantTempertureValid = mpt.Signal(StorageClass="ExportedGlobal", DataType="uint8")
CSP_EngineSpeed = mpt.Signal(StorageClass="ExportedGlobal", DataType="single")
CSP_TotalOdo = mpt.Signal(StorageClass="ExportedGlobal", DataType="uint32")
CSP_ABM_CheckSum = mpt.Signal(StorageClass="ExportedGlobal", DataType="uint8")
CSP_ABM_MsgCounter = mpt.Signal(StorageClass="ExportedGlobal", DataType="uint8")
CSP_VehSpeed = mpt.Signal(StorageClass="ExportedGlobal", DataType="single")
CSP_VehSpeedValid = mpt.Signal(StorageClass="ExportedGlobal", DataType="uint8")
CSP_ExtTempValid = mpt.Signal(StorageClass="ExportedGlobal", DataType="uint8")
CSP_ExtTemp = mpt.Signal(StorageClass="ExportedGlobal", DataType="single")
CSP_ISG_Curr = mpt.Signal(StorageClass="ExportedGlobal", DataType="single")
CSP_ISG_Volt = mpt.Signal(StorageClass="ExportedGlobal", DataType="single")
CSP_ISG_ModeSt = mpt.Signal(StorageClass="ExportedGlobal", DataType="uint8")
CSP_TMF_ModeSt = mpt.Signal(StorageClass="ExportedGlobal", DataType="uint8")
CSP_TMF_Volt = mpt.Signal(StorageClass="ExportedGlobal", DataType="single")
CSP_TMF_Curr = mpt.Signal(StorageClass="ExportedGlobal", DataType="single")
CSP_TBOX_ChargeAllow = mpt.Signal(StorageClass="ExportedGlobal", DataType="uint8")
CSP_rPackChargeStopSOC = Simulink.Signal(StorageClass="ExportedGlobal", DataType="single")
CSP_VCU_AccessoryConsumePwr = Simulink.Signal(StorageClass="ExportedGlobal", DataType="single")
CSP_VCU_BMSAcChrgPerm = Simulink.Signal(StorageClass="ExportedGlobal", DataType="uint8")
CSP_VCU_BMSDcChrgPerm = Simulink.Signal(StorageClass="ExportedGlobal", DataType="uint8")
CSP_VCU_BMSHVreq = Simulink.Signal(StorageClass="ExportedGlobal", DataType="uint8")
CSP_VCU_BMSRequestMode = Simulink.Signal(StorageClass="ExportedGlobal", DataType="uint8")
CSP_VCU_BMSVehDcChrgnIDmd = Simulink.Signal(StorageClass="ExportedGlobal", DataType="single")
CSP_VCU_BMSVehDcChrgnUDmd = Simulink.Signal(StorageClass="ExportedGlobal", DataType="single")
CSP_VCU_PreheatKpWmAllw = Simulink.Signal(StorageClass="ExportedGlobal", DataType="uint8")
CSP_stExitStationHeatAllow = Simulink.Signal(StorageClass="ExportedGlobal", DataType="uint8")
OBD_PermanentFailureCycle = mpt.Signal(StorageClass="ExportedGlobal", DataType="uint8")
CSP_OBCMaxChgCurrent = mpt.Signal(StorageClass="ExportedGlobal", DataType="single")
CSP_stVCUDisChrgCathodeRlyCtrl = Simulink.Signal(StorageClass="ExportedGlobal", DataType="uint8")
CSP_CrashOutputSts = mpt.Signal(StorageClass="ExportedGlobal", DataType="uint8")
CSP_stCPErrLvl = Simulink.Signal(StorageClass="ExportedGlobal", DataType="uint8")
CSP_iCPChrgCurr = Simulink.Signal(StorageClass="ExportedGlobal", DataType="single")
CSP_stCPConn = Simulink.Signal(StorageClass="ExportedGlobal", DataType="uint8")
FINALLY_DEFECT = Simulink.Parameter(3, StorageClass="Define", HeaderFile="ModelDefines.h", DataType="uint8")
FINALLY_HEALED = Simulink.Parameter(1, StorageClass="Define", HeaderFile="ModelDefines.h", DataType="uint8")
NO_DIAGNOSIS = Simulink.Parameter(0, StorageClass="Define", HeaderFile="ModelDefines.h", DataType="uint8")
PRELIMINARY_DEFECT = Simulink.Parameter(2, StorageClass="Define", HeaderFile="ModelDefines.h", DataType="uint8")
PRELIMINARY_HEALED = Simulink.Parameter(4, StorageClass="Define", HeaderFile="ModelDefines.h", DataType="uint8")
STD_FALSE = mpt.Parameter(0, StorageClass="Define", HeaderFile="ModelDefines.h", DataType="uint8")
STD_TRUE = mpt.Parameter(1, StorageClass="Define", HeaderFile="ModelDefines.h", DataType="uint8")
STD_OFF = mpt.Parameter(0, StorageClass="Define", HeaderFile="ModelDefines.h", DataType="uint8")
STD_ON = mpt.Parameter(1, StorageClass="Define", HeaderFile="ModelDefines.h", DataType="uint8")
CSP_OBC_ChgSts_PHEV = Simulink.Signal(StorageClass="ExportedGlobal", DataType="uint8")
CSP_OBC_S2SwtReq = Simulink.Signal(StorageClass="ExportedGlobal", DataType="uint8")
CSP_ACU_3_CrashOutputSts = Simulink.Signal(StorageClass="ExportedGlobal", DataType="uint8")
CSP_OBC_CP_LineSts = Simulink.Signal(StorageClass="ExportedGlobal", DataType="uint8")
CSP_FRZCUDCPortTemp_N = Simulink.Signal(StorageClass="ExportedGlobal", DataType="single")
CSP_FRZCUDCPortTemp_P = Simulink.Signal(StorageClass="ExportedGlobal", DataType="single")
CSP_VCU_PRNDGearAct = Simulink.Signal(StorageClass="ExportedGlobal", DataType="uint8")
CSP_VCU_HvBattKeepWarmActiveReq = Simulink.Signal(StorageClass="ExportedGlobal", DataType="uint8")
CSP_VCU_BMSPreheatKeepWarmAllow = Simulink.Signal(StorageClass="ExportedGlobal", DataType="uint8")
CSP_VCUBMSAcChrgPerm = Simulink.Signal(StorageClass="ExportedGlobal", DataType="uint8")
CSP_VCUBMSDcChrgPerm = Simulink.Signal(StorageClass="ExportedGlobal", DataType="uint8")
CSP_FRZCUCIntTHvBattIn = Simulink.Signal(StorageClass="ExportedGlobal", DataType="single")
CSP_FRZCUCIntTHvBattOut = Simulink.Signal(StorageClass="ExportedGlobal", DataType="single")
CSP_VehicleSpeedVSOSig = Simulink.Signal(StorageClass="ExportedGlobal", DataType="single")
CSP_TotalOdometerkm = Simulink.Signal(StorageClass="ExportedGlobal", DataType="single")
CSP_VehicleSpeedVSOSigValidData = Simulink.Signal(StorageClass="ExportedGlobal", DataType="uint8")
CSP_VCC_1_OTASts = Simulink.Signal(StorageClass="ExportedGlobal", DataType="uint8")
CSP_OBC_MaxOutputPower = Simulink.Signal(StorageClass="ExportedGlobal", DataType="single")
CSP_EngineSpeedActual = Simulink.Signal(StorageClass="ExportedGlobal", DataType="single")
CSP_BpsPressureDataAlarm = Simulink.Signal(StorageClass="ExportedGlobal", DataType="single")
CSP_BpsPressureData = Simulink.Signal(StorageClass="ExportedGlobal", DataType="single")
CSP_BpsOverAbsThresholdFlg = Simulink.Signal(StorageClass="ExportedGlobal", DataType="uint8")
CSP_BpsOverSlopeThresholdFlg = Simulink.Signal(StorageClass="ExportedGlobal", DataType="uint8")
CSP_stStatusInternalErr = Simulink.Signal(StorageClass="ExportedGlobal", DataType="uint8")
CSP_stStatusPowerSup = Simulink.Signal(StorageClass="ExportedGlobal", DataType="uint8")
CSP_stCurrSensErr = Simulink.Signal(StorageClass="ExportedGlobal", DataType="uint8")
CSP_stADCTransFault = Simulink.Signal(StorageClass="ExportedGlobal", DataType="uint8")
CSP_iCurrZh = Simulink.Signal(StorageClass="ExportedGlobal", DataType="uint32")
CSP_stHardFaultZh = Simulink.Signal(StorageClass="ExportedGlobal", DataType="uint8")
CSP_tShuntTempZh = Simulink.Signal(StorageClass="ExportedGlobal", DataType="single")
CSP_tPCBTempZh = Simulink.Signal(StorageClass="ExportedGlobal", DataType="single")
CSP_stPCBOverTempZh = Simulink.Signal(StorageClass="ExportedGlobal", DataType="uint8")
CSP_stPCBTempFault = Simulink.Signal(StorageClass="ExportedGlobal", DataType="uint8")
CSP_stShuntOverTemp = Simulink.Signal(StorageClass="ExportedGlobal", DataType="uint8")
CSP_stShuntTempFault = Simulink.Signal(StorageClass="ExportedGlobal", DataType="uint8")
CSP_iCurrGx = Simulink.Signal(StorageClass="ExportedGlobal", DataType="uint32")
PROJECT_TYPE = mpt.Parameter(0, StorageClass="ImportedDefine", HeaderFile="app_cfg.h", DataType="uint8")
CSP_BpsPressureDataAlarmZh = Simulink.Signal(StorageClass="ExportedGlobal", DataType="single")
CSP_BpsPressureDataAlarmGx = Simulink.Signal(StorageClass="ExportedGlobal", DataType="single")
CSP_BpsPressureDataGx = Simulink.Signal(StorageClass="ExportedGlobal", DataType="single")
CSP_BpsOverSlopeThresholdFlgGx = Simulink.Signal(StorageClass="ExportedGlobal", DataType="uint8")
CSP_BpsOverAbsThresholdFlgGx = Simulink.Signal(StorageClass="ExportedGlobal", DataType="uint8")
CSP_BpsPressureDataZh = Simulink.Signal(StorageClass="ExportedGlobal", DataType="single")
CSP_BpsOverSlopeThresholdFlgZh = Simulink.Signal(StorageClass="ExportedGlobal", DataType="uint8")
CSP_BpsOverAbsThresholdFlgZh = Simulink.Signal(StorageClass="ExportedGlobal", DataType="uint8")
CSP_BpsInternalErrorFlagGx = Simulink.Signal(StorageClass="ExportedGlobal", DataType="uint8")
CSP_BpsInternalErrorFlagZh = Simulink.Signal(StorageClass="ExportedGlobal", DataType="uint8")
CSP_ExternalTemperature_C = Simulink.Signal(StorageClass="ExportedGlobal", DataType="single")
CSP_VCU_TargetSOC = Simulink.Signal(StorageClass="ExportedGlobal", DataType="single", InitialValue="100")
CSP_HCU_PtSts = Simulink.Signal(StorageClass="ExportedGlobal", DataType="uint8")
EVCC_GB_Rx_Error = Simulink.Signal(StorageClass="ExportedGlobal", DataType="uint8")
EVCC_GB_Special_Error = Simulink.Signal(StorageClass="ExportedGlobal", DataType="uint8")
EVCC_ElectronicLockSts = Simulink.Signal(StorageClass="ExportedGlobal", DataType="uint8")
EVCC_GunConnectSt = Simulink.Signal(StorageClass="ExportedGlobal", DataType="uint8")
EVCC_CC2_Alarm = Simulink.Signal(StorageClass="ExportedGlobal", DataType="uint8")
EVCC_CC2_ConnectSts = Simulink.Signal(StorageClass="ExportedGlobal", DataType="uint8")
EVCC_DCMinusTemp = Simulink.Signal(StorageClass="ExportedGlobal", DataType="single")
EVCC_DCPlusTemp = Simulink.Signal(StorageClass="ExportedGlobal", DataType="single")
PROJECT_INT_FLAG = mpt.Parameter(0, StorageClass="ImportedDefine", HeaderFile="app_cfg.h", DataType="uint8")
CSP_EVCC_stCC2Conn = Simulink.Signal(StorageClass="ExportedGlobal", DataType="uint8")
CSP_iDigitalCurrGx = Simulink.Signal(StorageClass="ExportedGlobal", DataType="single")
CSP_stCanHallErr = Simulink.Signal(StorageClass="ExportedGlobal", DataType="uint8")
SSP_uBatTtlVolt = Simulink.Signal(StorageClass="ImportedExtern", DataType="single")
ASPP_uBatPosVltgOrig = Simulink.Signal(StorageClass="ImportedExtern", DataType="single")
ASP_uBatPosVltgOrig = Simulink.Signal(StorageClass="ImportedExtern", DataType="single")
CSP_rBpsPressureData = Simulink.Signal(StorageClass="ExportedGlobal", DataType="single")