% Simulink data dictionary LED.sldd

BSW_uADC_PA11 = Simulink.Signal(StorageClass="ExportedGlobal", DataType="single")
CAN_msgCtrlCmd = Simulink.Signal(StorageClass="ExportedGlobal")
CAN_msgSts = Simulink.Signal(StorageClass="ExportedGlobal")